# Grasshopper definition Demo.gh (Grasshopper 1.0.7)
# plug-ins: ghWebSocket Info, GhPublishParameters

new_slider = Slider(9, range=0..10)
new = Slider(67, range=10..100)
hiiiiiii = Slider(9, range=5..10)
merge = Merge(Data1=new_slider, Data2=new)
retrieve_guid = RetrieveGUID(Input1=new_slider, Input2=Slider(4, range=0..10), Input3=new, Input4=Slider(1.4, range=0.001..2))  # -> GUIDs, JSONString
websocket_client = WebSocketClient(Host="localhost", Port="8181", Reconnect=Button())
websocket_state = WebSocketState(Socket=websocket_client)
panel = Panel(websocket_state)
websocket_receive = WebSocketReceive(Socket=websocket_client)
websocket_send = WebSocketSend(Socket=websocket_client, Message=retrieve_guid.JSONString, Broadcast=Toggle(True), ForceSend=Button())
panel_2 = Panel(websocket_receive)
panel_3 = Panel(websocket_send)
